# Grasshopper definition tarea4_robotica.gh (Grasshopper 1.0.8)
# plug-ins: KUKA|prc - parametric robot control

crv = Curve([<curve referenced from the Rhino model> x4])
crv_2 = Curve(<curve referenced from the Rhino model>)
crv_3 = Curve([<curve referenced from the Rhino model> x8])
disc = Discontinuity(Curve=crv_2, Level=1)  # -> Points, Parameters
disc_2 = Discontinuity(Curve=crv_3, Level=1)  # -> Points, Parameters
divlength = DivideLength(Curve=crv, Length=Slider(3.301, range=0..100))  # -> Points, Tangents, Parameters
xy = XYPlane(Origin=disc.Points)
xy_2 = XYPlane(Origin=disc_2.Points)
xy_3 = XYPlane(Origin=divlength.Points)
item = ListItem(List=xy, Index=0, Wrap=True)
item_2 = ListItem(List=xy_2, Index=0, Wrap=True)
item_3 = ListItem(List=xy_3, Index=0, Wrap=True)
number_slider = Slider(55.075, range=0..100)
merge = Merge(Data1=xy, Data2=item)
merge_2 = Merge(Data1=xy_2, Data2=item_2)
merge_3 = Merge(Data1=xy_3, Data2=item_3)
lin_move = LINearMovementKUKAPrc(TargetAsPlane=merge_3, extaxenabled=False, interpolation="C_DIS")  # -> flatten(KUKAPrcCommand)
lin_move_2 = LINearMovementKUKAPrc(TargetAsPlane=merge, extaxenabled=False, interpolation="C_DIS")
lin_move_3 = LINearMovementKUKAPrc(TargetAsPlane=merge_2, extaxenabled=False, interpolation="C_DIS")
tool_axis_offset = ToolAxisOffsetKUKAPrc(KUKAPrcCommand=lin_move_2, OffsetAlongToolaxis=number_slider, OffsetStart=True, OffsetEnd=True)
tool_axis_offset_2 = ToolAxisOffsetKUKAPrc(KUKAPrcCommand=lin_move_3, OffsetAlongToolaxis=number_slider, OffsetStart=True, OffsetEnd=True)
tool_axis_offset_3 = ToolAxisOffsetKUKAPrc(KUKAPrcCommand=lin_move, OffsetAlongToolaxis=number_slider, OffsetStart=True, OffsetEnd=True)
kress_spindle = Kress1050SpindleKUKAPrc(ToolLength=50, ToolDiameter=6, ToolNumber=6)
merge_4 = Merge(Data1=tool_axis_offset, Data2=tool_axis_offset_2, Data3=tool_axis_offset_3)
kr3_r540 = AgilusKR3R540Robot(infiniterot=False)
kuka_prc = KUKAPrcCORE(
    SimulationSlider=Slider(1, range=0..1),
    KUKAPrcCommands=flatten(merge_4),
    Tool=kress_spindle,
    Robot=kr3_r540,
    PRC_BaseExpose=False,
    PRC_SaveNameExpose=False,
    PRCsettings="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")  # -> RobotGeometry, AnalysisOutput
